# Dynamo graph TRH17_GEOMETRIC_EVALUATOR.dyn (Dynamo 2.17.0.3472)

file_path = Filename("C:\Users\kymaharaj\OneDrive - INGEROP\Desktop\Python_Projects\sa_geometric_design.py")  # graph input
integer_slider = IntegerSlider(115, range=0..120 step 1)  # graph input
string = StringInput("Rolling")  # graph input
select_landxml_file = Filename("No file selected.")  # graph input
python_script = Python(IN[0]=file_path, IN[1]=integer_slider, IN[2]=string, IN[3]=select_landxml_file)  # CPython3
# ---------- python_script.python (29 lines) ----------
import sys
import subprocess
import os

# 1. Grab the inputs from the Dynamo wires
script_path = IN[0]
speed = str(IN[1])
topo = IN[2]
xml_path = IN[3]  

# 2. Extract the exact folder where your script lives
work_dir = os.path.dirname(script_path)

# 3. Fire the command line, passing the XML path to the engine
try:
    result = subprocess.run(
        [r"C:\Users\kymaharaj\AppData\Local\Python\pythoncore-3.14-64\python.exe", script_path, xml_path, speed, topo],
        cwd=work_dir,
        capture_output=True, 
        text=True,
        check=True
    )
    OUT = "[SUCCESS] Excel Report Generated!\n" + result.stdout
except subprocess.CalledProcessError as e:
    # If the VS Code script fails, this will print the exact reason
    OUT = "❌ SCRIPT ERROR:\n" + e.stderr + "\n" + e.stdout
except Exception as e:
    # If Windows fails to find Python entirely
    OUT = "❌ SYSTEM ERROR: " + str(e)
# ----------------------------------------
watch = Watch(python_script)  # graph output
